# Grasshopper definition main.gh (Grasshopper 1.0.8)

path = FilePath("/Users/sanghoon/Documents/GitHub/BuildableRegionGenrator/data/Gangnam.shp")
number_slider = Slider(100, range=0..100)
panel = Panel("1168010600109000052")
list = ValueList({"1168010800100880001", "1168010800100880007", "1168010800100880008", "1168010800100880009", "1168010800100880011"}, selected="1168010800100880007")
panel_2 = Panel("1168010100106010014")
py3 = Python3Script(script=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, shp_dir=path, all_types=Toggle(True), setback_type=Slider(6, range=0..10))  # -> out; inputs all_types: Boolean, setback_type: Int32, target_lot_limit: Int32; disabled; unedited script template
py3_2 = Python3Script(script=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, shp_path=path, pnu=list)  # -> out, target_lot, other_lots; inputs pnu: String; unedited script template
py3_3 = Python3Script(lot=py3_2.target_lot, lots=py3_2.other_lots)  # -> out, bd, apart_regions, other_regions; inputs lots: list
# ---------- py3_3: Python ----------
crvs = [lot.region for lot in lots]
bd = lot.region
other_regions = [lot.region for lot in lots if lot.landuse_code == '13' or lot.landuse_code == '14' or lot.landuse_code == '15']
apart_regions = [lot.region for lot in lots if lot.is_apartment]

print(len(crvs), len(other_regions))
# ---------- end py3_3 ----------
number_slider_2 = Slider(0, range=0..100)
number_slider_3 = Slider(13, range=10..25)
panel_3 = Panel(py3)
number_slider_4 = Slider(3, range=0..10)
number_slider_5 = Slider(6, range=0..10)
number_slider_6 = Slider(9, range=0..10)
number_slider_7 = Slider(15, range=0..100)
number_slider_8 = Slider(12, range=0..100)
number_slider_9 = Slider(18, range=0..100)
boundary = BoundarySurfaces(Edges=py3_3.bd)
panel_4 = Panel(py3_2.out)
preview = CustomPreview(Geometry=boundary, Material=ColourSwatch(SwatchColor=RGB(191, 191, 191)))
py3_4 = Python3Script(
    script=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,
    target_lot=py3_2.target_lot,
    other_lots=py3_2.other_lots,
    height=[number_slider_5, number_slider_6, number_slider_8, number_slider_7, number_slider_9, number_slider_4, number_slider_2],
    setback_type=Slider(1, range=1..2))  # -> out, northsky_base_segments, northsky_buildable_boundary, offset_lot_region, northsky_cutter_breps; inputs other_lots: list, height: Double, setback_type: Int32; unedited script template
Z = UnitZ(Factor=[number_slider_5, number_slider_6, number_slider_8, number_slider_7, number_slider_9, number_slider_4, number_slider_2])
move = Move(Geometry=py3_4.northsky_buildable_boundary, Motion=Z)  # -> Geometry, Transform
linetype = ModelLinetype(Name="li", Width=Slider(0.1, range=0.1..2))  # -> Linetype, Name, Segments, CapStyle, JoinStyle, Width, WidthUnits
curve_preview = CustomCurvePreview(
    Curve=[py3_3.apart_regions, py3_3.other_regions, py3_3.bd],
    Linetype=linetype.Linetype,
    Colour=ColourSwatch(SwatchColor=RGB(10, 10, 10)))
preview_2 = CustomPreview(Geometry=py3_4.northsky_cutter_breps, Material=ColourSwatch(SwatchColor=RGBA(199, 109, 109, 38)))
linetype_2 = ModelLinetype(Name="li", Width=Slider(0.3, range=0.1..2))  # -> Linetype, Name, Segments, CapStyle, JoinStyle, Width, WidthUnits
curve_preview_2 = CustomCurvePreview(Curve=move.Geometry, Linetype=linetype_2.Linetype, Colour=ColourSwatch(SwatchColor=RGB(10, 10, 10)))
panel_5 = Panel(py3_4.out)
