# Grasshopper definition main.gh (Grasshopper 1.0.8)

number_slider = Slider(100, range=0..100)
list = ValueList({"1168010800100880001", "1168010800100880007", "1168010800100880008", "1168010800100880009", "1168010800100880011"}, selected="1168010800100880001")
path = FilePath("/Users/sanghoon/Documents/GitHub/BuildableRegionGenrator/data/Gangnam.shp")
panel = Panel("1168010600109000052")
py3 = Python3Script(script=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, shp_dir=path)  # -> out; inputs target_lot_limit: Int32; disabled; unedited script template
py3_2 = Python3Script(script=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, shp_path=path, pnu="1168010100106010014")  # -> out, target_lot, other_lots; inputs pnu: String; unedited script template
panel_2 = Panel(py3)
py3_3 = Python3Script(lot=py3_2.target_lot, lots=py3_2.other_lots)  # -> out, bd, apart_regions, other_regions; inputs lots: list
# ---------- py3_3: Python ----------
crvs = [lot.region for lot in lots]
bd = lot.region
other_regions = [lot.region for lot in lots if lot.landuse_code == '13' or lot.landuse_code == '14' or lot.landuse_code == '15']
apart_regions = [lot.region for lot in lots if lot.is_apartment]

print(len(crvs), len(other_regions))
# ---------- end py3_3 ----------
panel_3 = Panel(py3_2.out)
py3_4 = Python3Script(
    script=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,
    target_lot=py3_2.target_lot,
    other_lots=py3_2.other_lots,
    height=Slider(18, range=10..25),
    setback_type=Slider(2, range=1..2))  # -> out, northsky_base_segments, northsky_buildable_boundary, offset_lot_region, northsky_cutter_breps; inputs other_lots: list, height: Double, setback_type: Int32; unedited script template
boundary = BoundarySurfaces(Edges=py3_3.apart_regions)
preview = CustomPreview(
    Geometry=boundary,
    Material={diffuse=RGB(228, 178, 227), emission=RGB(68, 53, 68), shine=0.5, specular=RGB(255, 254, 255), transparency=0})
py3_5 = Python3Script()  # -> out, a, b, c, d, e, f, g, h; disabled
# ---------- py3_5: Python ----------
import scriptcontext as sc
import utils

a,b,c,d,e = sc.sticky["centered_seg"]

print(a,b,c,d,e)

c = c.region
d=d.region

f,g,h = sc.sticky["pt_projected"]
# ---------- end py3_5 ----------
panel_4 = Panel(py3_4.out)
sph = Sphere(Base=py3_5.g, Radius=1)  # disabled
boundary_2 = BoundarySurfaces(Edges=py3_5.c)  # disabled
pipe = Pipe(Curve=py3_5.h, Radius=1, Caps=0, FitRail=False)  # disabled
